# Grasshopper definition 1.gh (Grasshopper 1.0.7)
# plug-ins: Kangaroo2 Components, LunchBox, Weaverbird

curve = Curve(<curve referenced from the Rhino model>)
control_polygon = ControlPolygon(Curve=curve)  # -> Polygon, Points
number_slider = Slider(8, range=0..10)
list_item = ListItem(List=control_polygon.Points, Index=0, Wrap=True)  # -> Item, Item1, Item2, Item3
construct_domain² = ConstructDomain²(UMin=0, UMax=1, VMin=0, VMax=1)
_4point_surface = _4PointSurface(CornerA=list_item.Item, CornerB=list_item.Item1, CornerC=list_item.Item2, CornerD=list_item.Item3)
divide_domain² = DivideDomain²(Domain=construct_domain², UCount=Slider(14, range=0..100), VCount=number_slider)
partition_list = PartitionList(List=divide_domain², Size=number_slider)
isotrim = Isotrim(Surface=reparameterize(_4point_surface), Domain=partition_list)
area = Area(Geometry=isotrim)  # -> Area, graft(Centroid)
surface_points = SurfacePoints(Surface=isotrim)  # -> Points, Weights, Greville, UCount, VCount
list_item_2 = ListItem(List=surface_points.Points, Index=0, Wrap=True)  # -> Item, Item1, Item2, Item3
line = Line(StartPoint=list_item_2.Item3, EndPoint=area.Centroid)
line_2 = Line(StartPoint=list_item_2.Item2, EndPoint=area.Centroid)
line_3 = Line(StartPoint=list_item_2.Item1, EndPoint=area.Centroid)
line_4 = Line(StartPoint=list_item_2.Item, EndPoint=area.Centroid)
shift_paths = ShiftPaths(Data=line_2, Offset=-1)
shift_paths_2 = ShiftPaths(Data=line_4, Offset=-1)
shift_paths_3 = ShiftPaths(Data=line, Offset=-1)
shift_paths_4 = ShiftPaths(Data=line_3, Offset=-1)
flip_matrix = FlipMatrix(Data=shift_paths_2)
flip_matrix_2 = FlipMatrix(Data=shift_paths)
tree_statistics = TreeStatistics(Tree=shift_paths_4)  # -> Paths, Length, Count
tree_statistics_2 = TreeStatistics(Tree=shift_paths_2)  # -> Paths, Length, Count
tree_statistics_3 = TreeStatistics(Tree=shift_paths)  # -> Paths, Length, Count
tree_statistics_4 = TreeStatistics(Tree=shift_paths_3)  # -> Paths, Length, Count
cull_index = CullIndex(List=shift_paths_2, Indices=0, Wrap=True)
tree_statistics_5 = TreeStatistics(Tree=shift_paths_4)  # -> Paths, Length, Count
tree_statistics_6 = TreeStatistics(Tree=shift_paths)  # -> Paths, Length, Count
number_slider_2 = Slider(28, range=0..100)
number_slider_3 = Slider(16, range=0..100)
shift_list = ShiftList(List=tree_statistics_5.Paths, Shift=1, Wrap=False)
shortest_list = ShortestList(ListA=cull_index, ListB=shift_paths_3, TrimMode=2)  # -> ListA, ListB
list_item_3 = ListItem(List=reverse(tree_statistics_3.Paths), Index=0, Wrap=True)
list_item_4 = ListItem(List=tree_statistics.Paths, Index=0, Wrap=True)
list_item_5 = ListItem(List=reverse(tree_statistics_4.Paths), Index=0, Wrap=True)
list_item_6 = ListItem(List=tree_statistics_2.Paths, Index=0, Wrap=True)
list_item_7 = ListItem(List=shift_paths_2, Index=0, Wrap=True)
list_item_8 = ListItem(List=reverse(shift_paths_4), Index=0, Wrap=True)
list_item_9 = ListItem(List=shift_paths, Index=0, Wrap=True)
list_item_10 = ListItem(List=reverse(shift_paths_3), Index=0, Wrap=True)
shortest_list_2 = ShortestList(ListA=tree_statistics_6.Paths, ListB=shift_list, TrimMode=2)  # -> ListA, ListB
tree_branch = TreeBranch(Tree=shift_paths_4, Path=list_item_4, MaintainPaths=True)
tree_branch_2 = TreeBranch(Tree=shift_paths_2, Path=list_item_6, MaintainPaths=True)
tree_branch_3 = TreeBranch(Tree=shift_paths, Path=list_item_3, MaintainPaths=True)
tree_branch_4 = TreeBranch(Tree=shift_paths_3, Path=list_item_5, MaintainPaths=True)
tree_branch_5 = TreeBranch(Tree=shift_paths_4, Path=shift_list, MaintainPaths=True)
tree_branch_6 = TreeBranch(Tree=shift_paths, Path=shortest_list_2.ListA, MaintainPaths=True)
diamond_grid = DiamondGrid(Surface=_4point_surface, UDivisions=number_slider_2, VDivisions=number_slider_3)  # -> CornerPoint1, CornerPoint2, CornerPoint3, CornerPoint4, MidPoint, Normals
diamond_panels = DiamondPanels(Surface=_4point_surface, UDivisions=number_slider_2, VDivisions=number_slider_3)  # -> DiamondPanels, TriPanels
edge_surface = EdgeSurface(CurveA=tree_branch, CurveB=tree_branch_2)
edge_surface_2 = EdgeSurface(CurveA=tree_branch_3, CurveB=tree_branch_4)
curve_2 = Curve(curve)
edge_surface_3 = EdgeSurface(CurveA=tree_branch_6, CurveB=tree_branch_5)
edge_surface_4 = EdgeSurface(CurveA=shortest_list.ListA, CurveB=shortest_list.ListB)
edge_surface_5 = EdgeSurface(CurveA=list_item_7, CurveB=list_item_9)
edge_surface_6 = EdgeSurface(CurveA=list_item_8, CurveB=list_item_10)
deconstruct_brep = DeconstructBrep(Brep=diamond_panels.DiamondPanels)  # -> Faces, Edges, Vertices
deconstruct_brep_2 = DeconstructBrep(Brep=diamond_panels.TriPanels)  # -> Faces, Edges, Vertices
deconstruct_brep_3 = DeconstructBrep(Brep=edge_surface)  # -> Faces, Edges, Vertices
deconstruct_brep_4 = DeconstructBrep(Brep=edge_surface_2)  # -> Faces, Edges, Vertices
deconstruct_brep_5 = DeconstructBrep(Brep=edge_surface_5)  # -> Faces, Edges, Vertices
deconstruct_brep_6 = DeconstructBrep(Brep=edge_surface_6)  # -> Faces, Edges, Vertices
deconstruct_brep_7 = DeconstructBrep(Brep=edge_surface_3)  # -> Faces, Edges, Vertices
deconstruct_brep_8 = DeconstructBrep(Brep=edge_surface_4)  # -> Faces, Edges, Vertices
construct_mesh = ConstructMesh(Vertices=deconstruct_brep.Vertices, Faces={A=0, B=1, C=2, D=3})  # -> flatten(Mesh)
construct_mesh_2 = ConstructMesh(Vertices=deconstruct_brep_2.Vertices, Faces={A=0, B=1, C=2, D=2})  # -> flatten(Mesh)
construct_mesh_3 = ConstructMesh(Vertices=deconstruct_brep_3.Vertices, Faces={A=0, B=1, C=2, D=2})  # -> flatten(Mesh)
construct_mesh_4 = ConstructMesh(Vertices=deconstruct_brep_4.Vertices, Faces={A=0, B=1, C=2, D=2})  # -> flatten(Mesh)
construct_mesh_5 = ConstructMesh(Vertices=deconstruct_brep_5.Vertices, Faces={A=0, B=1, C=2, D=2})  # -> flatten(Mesh)
construct_mesh_6 = ConstructMesh(Vertices=deconstruct_brep_6.Vertices, Faces={A=0, B=1, C=2, D=2})  # -> flatten(Mesh)
construct_mesh_7 = ConstructMesh(Vertices=deconstruct_brep_7.Vertices, Faces={A=0, B=1, C=2, D=3})  # -> flatten(Mesh)
construct_mesh_8 = ConstructMesh(Vertices=deconstruct_brep_8.Vertices, Faces={A=0, B=1, C=2, D=3})  # -> flatten(Mesh)
combine_clean = CombineClean(Meshes=[construct_mesh, construct_mesh_2])
merge = Merge(
    Data1=construct_mesh_6,
    Data2=construct_mesh_5,
    Data3=construct_mesh_4,
    Data4=construct_mesh_3,
    Data5=construct_mesh_8,
    Data6=construct_mesh_7)
combine_clean_2 = CombineClean(Meshes=merge)
mesh = Mesh(combine_clean_2)
nakedvertices = NakedVertices(Mesh=mesh)  # -> ClothedIndex, NakedIndex, ClothedPts, NakedPts
point = Point([<point referenced from the Rhino model> x15])
point_2 = Point([<point referenced from the Rhino model> x9])
curve_3 = Curve(<curve referenced from the Rhino model>)
curve_4 = Curve(<curve referenced from the Rhino model>)
point_3 = Point([<point referenced from the Rhino model> x15])
point_4 = Point([<point referenced from the Rhino model> x9])
curve_5 = Curve(<curve referenced from the Rhino model>)
curve_6 = Curve(<curve referenced from the Rhino model>)
curve_7 = Curve(<curve referenced from the Rhino model>)
curve_8 = Curve(<curve referenced from the Rhino model>)
curve_9 = Curve(<curve referenced from the Rhino model>)
curve_10 = Curve(<curve referenced from the Rhino model>)
curve_closest_point = CurveClosestPoint(Point=point_3, Curve=reparameterize(curve_7))  # -> Point, Parameter, Distance
curve_closest_point_2 = CurveClosestPoint(Point=point, Curve=reparameterize(curve_3))  # -> Point, Parameter, Distance
curve_closest_point_3 = CurveClosestPoint(Point=point_4, Curve=reparameterize(curve_4))  # -> Point, Parameter, Distance
curve_closest_point_4 = CurveClosestPoint(Point=point_2, Curve=reparameterize(curve_6))  # -> Point, Parameter, Distance
point_5 = Point(nakedvertices.NakedPts)
warpweft = WarpWeft(Mesh=mesh)  # -> Warp, Weft, NakedA, NakedB
evaluate_curve = EvaluateCurve(Curve=reparameterize(curve_8), Parameter=curve_closest_point_2.Parameter)  # -> Point, Tangent, Angle
evaluate_curve_2 = EvaluateCurve(Curve=reparameterize(curve_10), Parameter=curve_closest_point.Parameter)  # -> Point, Tangent, Angle
evaluate_curve_3 = EvaluateCurve(Curve=reparameterize(curve_5), Parameter=curve_closest_point_3.Parameter)  # -> Point, Tangent, Angle
evaluate_curve_4 = EvaluateCurve(Curve=reparameterize(curve_9), Parameter=curve_closest_point_4.Parameter)  # -> Point, Tangent, Angle
dispatch = Dispatch(List=warpweft.Warp, DispatchPattern=warpweft.NakedA)  # -> ListA, ListB
dispatch_2 = Dispatch(List=warpweft.Weft, DispatchPattern=warpweft.NakedB)  # -> ListA, ListB
point_6 = Point([point, point_3])
number_slider_4 = Slider(1, range=0..10)
curve_11 = Curve(dispatch.ListB)
curve_12 = Curve(dispatch_2.ListB)
point_7 = Point([evaluate_curve.Point, evaluate_curve_2.Point])
deconstruct_mesh = DeconstructMesh(Mesh=mesh)  # -> Vertices, Faces, Colours, Normals
number_slider_5 = Slider(10000, range=0..10000)
number_slider_6 = Slider(1100, range=0..10000)
line_5 = Line(StartPoint=point_6, EndPoint=point_7)
join_curves = JoinCurves(Curves=curve_12, Preserve=False)  # -> graft(Curves)
join_curves_2 = JoinCurves(Curves=curve_11, Preserve=False)  # -> graft(Curves)
unit_z = UnitZ(Factor=expr("x*5", Button()))
number_slider_7 = Slider(0, range=0..10000)
length = Length(Curve=line_5)
show = Show(G=mesh)
rod = Rod(Polyline=join_curves_2, LengthFactor=1, AngleFactor=1, AxialStrength=number_slider_5, BendStrength=number_slider_6)  # -> flatten(R)
load = Load(Point=deconstruct_mesh.Vertices, ForceVector=unit_z, Weighting=1)
multiplication = Multiplication(A=length, B=Slider(0, range=0..1))
rod_2 = Rod(Polyline=join_curves, LengthFactor=1, AngleFactor=1, AxialStrength=number_slider_5, BendStrength=number_slider_6)  # -> flatten(R)
smooth = Smooth(M=mesh, Strength=number_slider_7)
conicalize = Conicalize(M=mesh, Strength=number_slider_7)
pressure = Pressure(M=mesh, Strength=Slider(0, range=0..100))
planarize = Planarize(M=mesh, Strength=number_slider_7)
length_line = LengthLine(Line=line_5, Length=multiplication, Strength=Slider(10000, range=0..10000))
anchor = Anchor(Point=point_7, Strength=100000)
entwine = Entwine(
    Branch00=rod,
    Branch01=rod_2,
    Branch02=length_line,
    Branch03=anchor,
    Branch04=show,
    Branch05=load,
    Branch06=pressure,
    FlattenInputs=True)
solver = Solver(Reset=False, Threshold=1e-15, Tolerance=0.0001, On=True)  # -> I, V, O
bouncysolver = BouncySolver(GoalObjects=entwine, Reset=Button(), Threshold=1e-15, Tolerance=0.0001, Damping=0.99, Iterations=10, On=Toggle(True))  # -> I, V, O
unflatten = UnflattenTree(Tree=bouncysolver.O, Guide=entwine)
bang = ExplodeTree(Data=unflatten)  # -> Branch0, Branch1, Branch2, Branch3, Branch4, Branch5, Branch6
mesh_2 = Mesh(bang.Branch4)
weaverbird_s_mesh_edges = WeaverbirdsMeshEdges(MeshOrPolylines=mesh_2)
warpweft_2 = WarpWeft(Mesh=mesh_2)  # -> Warp, Weft, NakedA, NakedB
length_2 = Length(Curve=weaverbird_s_mesh_edges)
dispatch_3 = Dispatch(List=warpweft_2.Weft, DispatchPattern=warpweft_2.NakedB)  # -> ListA, ListB
dispatch_4 = Dispatch(List=warpweft_2.Warp, DispatchPattern=warpweft_2.NakedA)  # -> ListA, ListB
curve_13 = Curve(dispatch_3.ListB)
bounds = Bounds(Numbers=length_2)
curve_14 = Curve(dispatch_4.ListB)
beam = Beam(E=1, A=1, Ix=1, Iy=1, GJ=1)
join_curves_3 = JoinCurves(Curves=curve_14, Preserve=False)
bar_graph = BarGraph(length_2, BarColor=RGB(255, 0, 90))
control_polygon_2 = ControlPolygon(Curve=join_curves_3)  # -> Polygon, Points
quick_graph = QuickGraph(length_2, SortOrder=1)
relative_item = RelativeItem(Tree=simplify(control_polygon_2.Points), Offset="{1}", WrapPaths=False, WrapItems=False)  # -> ItemA, ItemB
point_8 = Point(control_polygon_2.Points)
shift_list_2 = ShiftList(List=relative_item.ItemB, Shift=1, Wrap=False)
interpolate = Interpolate(Vertices=point_8, Degree=3, Periodic=False, KnotStyle=1)  # -> Curve, Length, Domain
line_6 = Line(StartPoint=relative_item.ItemA, EndPoint=shift_list_2)
