# Grasshopper definition introduccion a grasshopper kangaroo.gh (Grasshopper 1.0.7)
# plug-ins: Kangaroo2 Components

# ---- group: paso 2: simulacion de varias catenarias
curve = Curve(<curve referenced from the Rhino model>)
curve_2 = Curve(<curve referenced from the Rhino model>)
divide_curve = DivideCurve(Curve=curve_2, Count=10, Kinks=False)  # -> Points, Tangents, Parameters
divide_curve_2 = DivideCurve(Curve=curve, Count=10, Kinks=False)  # -> Points, Tangents, Parameters
line = Line(StartPoint=divide_curve_2.Points, EndPoint=divide_curve.Points)
divide_curve_3 = DivideCurve(Curve=line, Count=10, Kinks=False)  # -> Points, Tangents, Parameters
shatter = Shatter(Curve=graft(line), Parameters=divide_curve_3.Parameters)
load = Load(Point=divide_curve_3.Points, ForceVector=Vector(0, 0, 1), Weighting=1)
length_line = LengthLine(Line=shatter, Strength=10)
anchor = Anchor(Point=[divide_curve_2.Points, divide_curve.Points], Strength=10000)
show = Show()
bouncysolver = BouncySolver(
    GoalObjects=[length_line, load, anchor, show],
    Reset=Button(),
    Threshold=1e-15,
    Tolerance=0.01,
    Damping=0.99,
    Iterations=10,
    On=True)  # -> I, V, O
curve_3 = Curve(bouncysolver.O)
join_curves = JoinCurves(Curves=curve_3, Preserve=False)
rebuild_curve = RebuildCurve(Curve=join_curves, Degree=3, Count=10, Tangents=False)
loft = Loft(Curves=rebuild_curve, Options={Adjust=False, Closed=False, LoftEnds=0, LoftSimp=0, LoftType=0, Rebuild=10, Refit=0.01})

# ---- group: paso 1 simulacion de una catenaria
point = Point(<point referenced from the Rhino model>)
point_2 = Point(<point referenced from the Rhino model>)
line_2 = Line(StartPoint=point, EndPoint=point_2)
divide_curve_4 = DivideCurve(Curve=line_2, Count=Slider(25, range=0..100), Kinks=False)  # -> Points, Tangents, Parameters
shatter_2 = Shatter(Curve=line_2, Parameters=divide_curve_4.Parameters)
load_2 = Load(Point=divide_curve_4.Points, ForceVector=Vector(0, 0, 1), Weighting=1)
anchor_2 = Anchor(Point=[point, point_2], Strength=10000)
length_line_2 = LengthLine(Line=shatter_2, Strength=10)
bouncysolver_2 = BouncySolver(
    GoalObjects=[length_line_2, load_2, anchor_2],
    Reset=Button(),
    Threshold=1e-15,
    Tolerance=0.01,
    Damping=0.99,
    Iterations=10,
    On=True)  # -> I, V, O

# ----
shift_list = ShiftList(List=divide_curve.Points, Shift=Slider(6, range=0..10), Wrap=True)
geodesic = Geodesic(Surface=loft, Start=divide_curve_2.Points, End=shift_list)
